# Grasshopper definition CAADRIA_EarthyIndex_1_DataStack.gh (Grasshopper 1.0.7)
# plug-ins: Hops

# Manaus - Brazil
panel = Panel("-60.8274,-3.6796,-59.1864,-2.3821")
split = TextSplit(Text=panel, Separators=",")
dispatch = Dispatch(List=split, DispatchPattern=[True, False])  # -> ListA, ListB
pt = ConstructPoint(XCoordinate=dispatch.ListA, YCoordinate=dispatch.ListB, ZCoordinate=0)
item = ListItem(List=pt, Index=0, Wrap=True)  # -> Item, Item1
rec_2pt = Rectangle2Pt(Plane=PlaneXY(0, 0, 0), PointA=item.Item, PointB=item.Item1, Radius=0)  # -> Rectangle, Length
number_slider = Slider(800, range=0..1000)
disc = Discontinuity(Curve=rec_2pt.Rectangle, Level=1)  # -> Points, Parameters
pt_2 = Point(disc.Points)
pt_3 = Point(disc.Points)
pt_4 = Point(disc.Points)
hops = Hops(
    Points=pt_2,
    Bool=Toggle(False),
    CacheResultsInMemory=False,
    CacheSolveResults=True,
    RemoteDefinitionLocation="http://127.0.0.1:5000/reproject_UTM",
    RemoteSolveVersion=(0, 1, 0),
    ShowInput_Enabled=False,
    ShowInput_Path=False,
    SynchronousSolve=True)
hops_2 = Hops(
    Layer="JRC/GSW1_3/GlobalSurfaceWater",
    Bands="occurrence",
    Mode="mean",
    Scale=number_slider,
    BoundingBox=pt_2,
    CacheResultsInMemory=False,
    CacheSolveResults=True,
    RemoteDefinitionLocation="http://127.0.0.1:5000/ee_image",
    RemoteSolveVersion=(0, 1, 0),
    ShowInput_Enabled=False,
    ShowInput_Path=False,
    SynchronousSolve=True)  # -> Values, W, H
hops_3 = Hops(
    Layer="CGIAR/SRTM90_V4",
    Bands="elevation",
    Mode="mean",
    Scale=number_slider,
    BoundingBox=pt_3,
    CacheResultsInMemory=False,
    CacheSolveResults=True,
    RemoteDefinitionLocation="http://127.0.0.1:5000/ee_image",
    RemoteSolveVersion=(0, 1, 0),
    ShowInput_Enabled=False,
    ShowInput_Path=False,
    SynchronousSolve=True)  # -> Values, W, H
hops_4 = Hops(
    Layer="UMD/hansen/global_forest_change_2020_v1_8",
    Bands="treecover2000",
    Mode="mean",
    Scale=number_slider,
    BoundingBox=pt_4,
    CacheResultsInMemory=False,
    CacheSolveResults=True,
    RemoteDefinitionLocation="http://127.0.0.1:5000/ee_image",
    RemoteSolveVersion=(0, 1, 0),
    ShowInput_Enabled=False,
    ShowInput_Path=False,
    SynchronousSolve=True)  # -> Values, W, H
hops_5 = Hops(
    Points=pt_4,
    Bool=Toggle(False),
    CacheResultsInMemory=False,
    CacheSolveResults=True,
    RemoteDefinitionLocation="http://127.0.0.1:5000/reproject_UTM",
    RemoteSolveVersion=(0, 1, 0),
    ShowInput_Enabled=False,
    ShowInput_Path=False,
    SynchronousSolve=True)
hops_6 = Hops(
    Points=pt_3,
    Bool=Toggle(False),
    CacheResultsInMemory=False,
    CacheSolveResults=True,
    RemoteDefinitionLocation="http://127.0.0.1:5000/reproject_UTM",
    RemoteSolveVersion=(0, 1, 0),
    ShowInput_Enabled=False,
    ShowInput_Path=False,
    SynchronousSolve=True)
pline = PolyLine(Vertices=reverse(hops), Closed=invert(False))
pline_2 = PolyLine(Vertices=reverse(hops_6), Closed=invert(False))
pline_3 = PolyLine(Vertices=reverse(hops_5), Closed=invert(False))
mplane = MeshPlane(Boundary=pline_2, WidthCount=hops_3.W, HeightCount=hops_3.H)  # -> Mesh, Area
mplane_2 = MeshPlane(Boundary=pline, WidthCount=hops_3.W, HeightCount=hops_2.H)  # -> Mesh, Area
mplane_3 = MeshPlane(Boundary=pline_3, WidthCount=hops_4.W, HeightCount=hops_4.H)  # -> Mesh, Area
bnd = Bounds(Numbers=hops_2.Values)
bnd_2 = Bounds(Numbers=hops_3.Values)
demesh = DeconstructMesh(Mesh=mplane_2.Mesh)  # -> Vertices, Faces, Colours, Normals
bnd_3 = Bounds(Numbers=hops_4.Values)
demesh_2 = DeconstructMesh(Mesh=mplane.Mesh)  # -> Vertices, Faces, Colours, Normals
demesh_3 = DeconstructMesh(Mesh=mplane_3.Mesh)  # -> Vertices, Faces, Colours, Normals
dedomain = DeconstructDomain(Domain=bnd)  # -> Start, End
dedomain_2 = DeconstructDomain(Domain=bnd_2)  # -> Start, End
dedomain_3 = DeconstructDomain(Domain=bnd_3)  # -> Start, End
Z = UnitZ(Factor=hops_3.Values)
gradient = Gradient(
    LowerLimit=dedomain.Start,
    UpperLimit=dedomain.End,
    Parameter=hops_2.Values,
    stops=[0: RGB(172, 220, 250), 1: RGB(61, 54, 186)])
gradient_2 = Gradient(
    LowerLimit=dedomain_2.End,
    UpperLimit=dedomain_2.Start,
    Parameter=hops_3.Values,
    stops=[0: RGB(255, 255, 255), 1: RGB(0, 0, 0)])
gradient_3 = Gradient(
    LowerLimit=dedomain_3.End,
    UpperLimit=dedomain_3.Start,
    Parameter=hops_4.Values,
    stops=[0: RGB(0, 98, 0), 0.25: RGB(81, 175, 17), 0.5: RGB(159, 198, 146), 0.75: RGB(170, 235, 41), 1: RGB(221, 255, 53)])
move = Move(Geometry=demesh_2.Vertices, Motion=Z)  # -> Geometry, Transform
smaller = SmallerThan(FirstNumber=hops_2.Values, SecondNumber=Slider(0, range=0..100))  # -> SmallerThan, OrEqualTo
smaller_2 = SmallerThan(FirstNumber=hops_4.Values, SecondNumber=Slider(0, range=0..100))  # -> SmallerThan, OrEqualTo
conmesh = ConstructMesh(Vertices=demesh.Vertices, Faces=demesh.Faces, Colours=gradient)
conmesh_2 = ConstructMesh(Vertices=move.Geometry, Faces=demesh_2.Faces, Colours=gradient_2)
conmesh_3 = ConstructMesh(Vertices=demesh_3.Vertices, Faces=demesh_3.Faces, Colours=gradient_3)
cullv = CullVertices(Mesh=conmesh, Pattern=smaller.SmallerThan, Shrink=True)
cullv_2 = CullVertices(Mesh=conmesh_3, Pattern=smaller_2.SmallerThan, Shrink=True)
tri = Triangulate(Mesh=conmesh_2)  # -> Mesh, Count
tri_2 = Triangulate(Mesh=cullv)  # -> Mesh, Count
tri_3 = Triangulate(Mesh=cullv_2)  # -> Mesh, Count
merge = Merge(Data1=tri.Mesh, Data2=tri_2.Mesh, Data3=tri_3.Mesh)
lng = ListLength(List=merge)
series = Series(Start=0, Step=Slider(100000, range=0..100000), Count=lng)
Z_2 = UnitZ(Factor=series)
move_2 = Move(Geometry=merge, Motion=Z_2)  # -> Geometry, Transform
