# Grasshopper definition CAADRIA_EarthyIndex_2_Visualization.gh (Grasshopper 1.0.7)
# plug-ins: Hops, Human

crv = Curve(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)  # disabled
crv_2 = Curve([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])  # disabled
disc = Discontinuity(Curve=crv, Level=1)  # -> Points, Parameters; disabled
item = ListItem(List=crv_2, Index=0, Wrap=True)  # -> Item, Item1, Item2; disabled
disc_2 = Discontinuity(Curve=item.Item, Level=1)  # -> Points, Parameters; disabled
panel = Panel("JRC/GSW1_3/GlobalSurfaceWater")  # disabled
number_slider = Slider(300, range=0..1000)  # disabled
pt = Point(disc.Points)  # disabled
panel_2 = Panel("occurrence")  # disabled
panel_3 = Panel("JRC/GSW1_3/GlobalSurfaceWater")  # disabled
number_slider_2 = Slider(300, range=0..1000)  # disabled
panel_4 = Panel("""recurrence
seasonality
max_extent""")  # disabled
toggle = BooleanToggle(False)  # disabled
pt_2 = Point(disc_2.Points)  # disabled
toggle_2 = BooleanToggle(False)  # disabled
hops = Hops(
    Points=pt,
    Bool=toggle,
    CacheResultsInMemory=False,
    CacheSolveResults=True,
    RemoteDefinitionLocation="http://127.0.0.1:5000/reproject_UTM",
    RemoteSolveVersion=(0, 1, 0),
    ShowInput_Enabled=False,
    ShowInput_Path=False,
    SynchronousSolve=True)  # disabled
hops_2 = Hops(
    Layer=panel,
    Bands=panel_2,
    Mode="mean",
    Scale=number_slider,
    BoundingBox=pt,
    CacheResultsInMemory=False,
    CacheSolveResults=True,
    RemoteDefinitionLocation="http://127.0.0.1:5000/ee_image",
    RemoteSolveVersion=(0, 1, 0),
    ShowInput_Enabled=False,
    ShowInput_Path=False,
    SynchronousSolve=True)  # -> Values, W, H; disabled
hops_3 = Hops(
    Points=pt_2,
    Bool=toggle_2,
    CacheResultsInMemory=False,
    CacheSolveResults=True,
    RemoteDefinitionLocation="http://127.0.0.1:5000/reproject_UTM",
    RemoteSolveVersion=(0, 1, 0),
    ShowInput_Enabled=False,
    ShowInput_Path=False,
    SynchronousSolve=True)  # disabled
hops_4 = Hops(
    Layer=panel_3,
    Bands=panel_4,
    Mode="mean",
    Scale=number_slider_2,
    BoundingBox=pt_2,
    CacheResultsInMemory=False,
    CacheSolveResults=True,
    RemoteDefinitionLocation="http://127.0.0.1:5000/ee_image",
    RemoteSolveVersion=(0, 1, 0),
    ShowInput_Enabled=False,
    ShowInput_Path=False,
    SynchronousSolve=True)  # -> Values, W, H; disabled
pline = PolyLine(Vertices=reverse(hops), Closed=invert(False))  # disabled
pline_2 = PolyLine(Vertices=reverse(hops_3), Closed=invert(False))  # disabled
item_2 = ListItem(List=hops_4.W, Index=0, Wrap=True)  # disabled
item_3 = ListItem(List=hops_4.H, Index=0, Wrap=True)  # disabled
mplane = MeshPlane(Boundary=pline, WidthCount=hops_2.W, HeightCount=hops_2.H)  # -> Mesh, Area; disabled
bnd = Bounds(Numbers=hops_2.Values)  # disabled
demesh = DeconstructMesh(Mesh=mplane.Mesh)  # -> Vertices, Faces, Colours, Normals; disabled
mplane_2 = MeshPlane(Boundary=pline_2, WidthCount=item_2, HeightCount=item_3)  # -> Mesh, Area; disabled
dedomain = DeconstructDomain(Domain=bnd)  # -> Start, End; disabled
bnd_2 = Bounds(Numbers=hops_4.Values)  # disabled
gradient = Gradient(
    LowerLimit=dedomain.Start,
    UpperLimit=dedomain.End,
    Parameter=hops_2.Values,
    stops=[0: RGB(172, 220, 250), 1: RGB(61, 54, 186)])  # disabled
panel_5 = Panel("1")  # disabled
remap = RemapNumbers(Value=hops_4.Values, Source=bnd_2, Target=panel_5)  # -> Mapped, Clipped; disabled
demesh_2 = DeconstructMesh(Mesh=mplane_2.Mesh)  # -> Vertices, Faces, Colours, Normals; disabled
number_slider_3 = Slider(30, range=0..100)  # disabled
bang = ExplodeTree(Data=remap.Mapped)  # -> Branch0, Branch1, Branch2; disabled
number_slider_4 = Slider(1500, range=0..10000)  # disabled
larger = LargerThan(FirstNumber=hops_2.Values, SecondNumber=number_slider_3)  # -> LargerThan, OrEqualTo; disabled
number_slider_5 = Slider(1, range=0..1000)  # disabled
number_slider_6 = Slider(500, range=0..1000)  # disabled
number_slider_7 = Slider(90, range=0..1000)  # disabled
gradient_2 = Gradient(LowerLimit=0, UpperLimit=1, Parameter=bang.Branch0, stops=[0.5: RGB(186, 54, 83), 1: RGB(127, 135, 223)])  # disabled
cull = CullPattern(List=demesh.Vertices, CullPattern=larger.LargerThan)  # disabled
dash = DashPattern(Curve=pline, Pattern=number_slider_4)  # -> Dashes, Gaps; disabled
multiplication = Multiplication(A=hops_2.Values, B=number_slider_5)  # disabled
qt = QuadTree(Points=cull, Plane=PlaneXY(0, 0, 0), Square=invert(False), Group=5)  # -> Quads, Points; disabled
multiplication_2 = Multiplication(A=bang.Branch1, B=number_slider_7)  # disabled
multiplication_3 = Multiplication(A=bang.Branch2, B=number_slider_6)  # disabled
Y = UnitY(Factor=1)  # disabled
Z = UnitZ(Factor=1)  # disabled
cir = Circle(Plane=demesh.Vertices, Radius=multiplication)  # disabled
vrot = Rotate(Vector=Y, Axis=Z, Angle=degrees(multiplication_2))  # disabled
line = LineSDL(Start=demesh_2.Vertices, Direction=vrot, Length=multiplication_3)  # disabled
number_slider_8 = Slider(2, range=0..10)  # disabled
swatch = ColourSwatch(SwatchColor=RGB(255, 0, 0))  # disabled
swatch_2 = ColourSwatch(SwatchColor=RGB(0, 0, 0))  # disabled

previewlw = CustomPreviewLineweights(Geometry=cir, Shader=gradient, Absolute=False)  # disabled
previewlw_2 = CustomPreviewLineweights(Geometry=qt.Quads, Shader=swatch, Absolute=False)  # disabled
previewlw_3 = CustomPreviewLineweights(Geometry=dash.Dashes, Shader=swatch_2, Absolute=False)  # disabled

previewlw_4 = CustomPreviewLineweights(Geometry=line, Shader=gradient_2, Thickness=number_slider_8, Absolute=False)  # disabled
