# Grasshopper definition CAADRIA_EarthyIndex_3_CumulativeCost.gh (Grasshopper 1.0.7)
# plug-ins: Hops

crv = Curve(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)
disc = Discontinuity(Curve=crv, Level=1)  # -> Points, Parameters
pt = Point(Point(9.459095786, 45.50614436, 0))
pt_2 = Point(disc.Points)

# ----
# .../ee_cumCost
hops = Hops(
    Layer="Oxford/MAP/friction_surface_2019",
    Cost="friction",
    Sources=pt,
    Maxdistance=Slider(90000, range=0..100000),
    Scale=Slider(250, range=0..1000),
    BoundingBox=pt_2,
    CacheResultsInMemory=True,
    CacheSolveResults=True,
    RemoteDefinitionLocation="http://127.0.0.1:5000/ee_cumCost",
    RemoteSolveVersion=(0, 1, 0),
    ShowInput_Enabled=False,
    ShowInput_Path=False,
    SynchronousSolve=False)  # -> Values, W, H

# ----
# .../reproject_UTM
hops_2 = Hops(
    Points=pt_2,
    Bool=Toggle(False),
    CacheResultsInMemory=True,
    CacheSolveResults=True,
    RemoteDefinitionLocation="http://127.0.0.1:5000/reproject_UTM",
    RemoteSolveVersion=(0, 1, 0),
    ShowInput_Enabled=False,
    ShowInput_Path=False,
    SynchronousSolve=True)

pline = PolyLine(Vertices=reverse(hops_2), Closed=invert(False))
bnd = Bounds(Numbers=hops.Values)
mplane = MeshPlane(Boundary=pline, WidthCount=hops.W, HeightCount=hops.H)  # -> Mesh, Area
dedomain = DeconstructDomain(Domain=bnd)  # -> Start, End
gradient = Gradient(
    LowerLimit=dedomain.Start,
    UpperLimit=Slider(42, range=0..100),
    Parameter=hops.Values,
    stops=[0: RGB(255, 255, 0), 1: RGB(61, 54, 186)])
demesh = DeconstructMesh(Mesh=mplane.Mesh)  # -> Vertices, Faces, Colours, Normals
Z = UnitZ(Factor=hops.Values)
move = Move(Geometry=demesh.Vertices, Motion=Z)  # -> Geometry, Transform
conmesh = ConstructMesh(Vertices=move.Geometry, Faces=demesh.Faces, Colours=gradient)
contour = Contour(Shape=conmesh, Point=Point(0, 0, 0), Direction=Vector(0, 0, 1), Distance=Slider(5, range=0..100))
