# Grasshopper definition GSS_UA_GoogleEarthEngineComponents.gh (Grasshopper 1.0.7)
# plug-ins: Hops

crv = Curve(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)
crv_2 = Curve(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)
crv_3 = Curve(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)
crv_4 = Curve(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)
crv_5 = Curve(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)
disc = Discontinuity(Curve=crv, Level=1)  # -> Points, Parameters
disc_2 = Discontinuity(Curve=crv_2, Level=1)  # -> Points, Parameters
disc_3 = Discontinuity(Curve=crv_5, Level=1)  # -> Points, Parameters
disc_4 = Discontinuity(Curve=crv_3, Level=1)  # -> Points, Parameters
divide = DivideCurve(Curve=crv_4, Count="200", Kinks=False)  # -> flatten(Points), Tangents, Parameters
panel = Panel("""511=1
512=1
521=1
522=1
523=1""")
pt = Point(Point(9.06182161, 39.24296148, 0))
pt_2 = Point(Point(9.06182161, 39.24296148, 0))

# ----
# .../ee_image
hops = Hops(
    Layer="COPERNICUS/CORINE/V20/100m/2012",
    Bands="landcover",
    Mode="mean",
    Scale=Slider(100, range=0..1000),
    Pts=disc.Points,
    CacheResultsInMemory=True,
    CacheSolveResults=True,
    RemoteDefinitionLocation="http://127.0.0.1:5000/ee_image",
    RemoteSolveVersion=(0, 1, 0),
    ShowInput_Enabled=False,
    ShowInput_Path=False,
    SynchronousSolve=False)  # -> Values, W, H

# ----
# .../ee_nd
hops_2 = Hops(
    Layer="LANDSAT/LE7_TOA_5YEAR/1999_2003",
    Band1="B4",
    Band2="B3",
    Mode="mean",
    Scale=Slider(100, range=0..1000),
    Pts=disc_2.Points,
    CacheResultsInMemory=True,
    CacheSolveResults=True,
    RemoteDefinitionLocation="http://127.0.0.1:5000/ee_nd",
    RemoteSolveVersion=(0, 1, 0),
    ShowInput_Enabled=False,
    ShowInput_Path=False,
    SynchronousSolve=False)  # -> Values, W, H

# ----
# .../ee_cumCost
hops_3 = Hops(
    Layer="Oxford/MAP/friction_surface_2019",
    Cost="friction",
    Sources=pt,
    Maxdistance=Slider(20000, range=0..100000),
    Scale=Slider(100, range=0..1000),
    Bbox=disc_4.Points,
    CacheResultsInMemory=True,
    CacheSolveResults=True,
    RemoteDefinitionLocation="http://127.0.0.1:5000/ee_cumCost",
    RemoteSolveVersion=(0, 1, 0),
    ShowInput_Enabled=False,
    ShowInput_Path=False,
    SynchronousSolve=False)  # -> Values, W, H

# ----
# .../ee_cumCostExtra
hops_4 = Hops(
    Layer="COPERNICUS/CORINE/V20/100m/2012",
    Cost="landcover",
    Remap=panel,
    Default=Slider(0.1, range=0..0.1),
    Paint=divide.Points,
    Val=Slider(0.012, range=0..0.1),
    Sources=pt_2,
    Maxdistance=Slider(30000, range=0..100000),
    Scale=Slider(100, range=0..1000),
    BoundingBox=disc_3.Points,
    CacheResultsInMemory=False,
    CacheSolveResults=False,
    RemoteDefinitionLocation="http://127.0.0.1:5000/ee_cumCostExtra",
    RemoteSolveVersion=(0, 1, 0),
    ShowInput_Enabled=False,
    ShowInput_Path=False,
    SynchronousSolve=False)  # -> Values, W, H

bnd = Bounds(Numbers=hops.Values)
dedomain = DeconstructDomain(Domain=bnd)  # -> Start, End
gradient = Gradient(
    LowerLimit=dedomain.Start,
    UpperLimit=dedomain.End,
    Parameter=hops.Values,
    stops=[0: RGB(243, 57, 0), 0.1: RGB(236, 27, 60), 0.2: RGB(210, 0, 118), 0.3: RGB(103, 0, 120), 0.4: RGB(39, 72, 161), 0.5: RGB(1, 192, 229), 0.6: RGB(18, 178, 90), 0.7: RGB(79, 186, 8), 0.8: RGB(220, 237, 32), 0.9: RGB(247, 159, 20), 1: RGB(0, 0, 0)])

bnd_2 = Bounds(Numbers=hops_2.Values)
dedomain_2 = DeconstructDomain(Domain=bnd_2)  # -> Start, End
gradient_2 = Gradient(
    LowerLimit=dedomain_2.Start,
    UpperLimit=dedomain_2.End,
    Parameter=hops_2.Values,
    stops=[0: RGB(243, 57, 0), 0.1: RGB(236, 27, 60), 0.2: RGB(210, 0, 118), 0.3: RGB(103, 0, 120), 0.4: RGB(39, 72, 161), 0.5: RGB(1, 192, 229), 0.6: RGB(18, 178, 90), 0.7: RGB(79, 186, 8), 0.8: RGB(220, 237, 32), 0.9: RGB(247, 159, 20), 1: RGB(0, 0, 0)])

bnd_3 = Bounds(Numbers=hops_3.Values)
dedomain_3 = DeconstructDomain(Domain=bnd_3)  # -> Start, End
gradient_3 = Gradient(
    LowerLimit=dedomain_3.Start,
    UpperLimit=dedomain_3.End,
    Parameter=hops_3.Values,
    stops=[0: RGB(243, 57, 0), 0.1: RGB(236, 27, 60), 0.2: RGB(210, 0, 118), 0.3: RGB(103, 0, 120), 0.4: RGB(39, 72, 161), 0.5: RGB(1, 192, 229), 0.6: RGB(18, 178, 90), 0.7: RGB(79, 186, 8), 0.8: RGB(220, 237, 32), 0.9: RGB(247, 159, 20), 1: RGB(0, 0, 0)])

bnd_4 = Bounds(Numbers=hops_4.Values)
dedomain_4 = DeconstructDomain(Domain=bnd_4)  # -> Start, End
gradient_4 = Gradient(
    LowerLimit=dedomain_4.Start,
    UpperLimit=Slider(2860, range=0..10000),
    Parameter=hops_4.Values,
    stops=[0: RGB(243, 57, 0), 0.1: RGB(236, 27, 60), 0.2: RGB(210, 0, 118), 0.3: RGB(103, 0, 120), 0.4: RGB(39, 72, 161), 0.5: RGB(1, 192, 229), 0.6: RGB(18, 178, 90), 0.7: RGB(79, 186, 8), 0.8: RGB(220, 237, 32), 0.9: RGB(247, 159, 20), 1: RGB(243, 57, 0)])

# ---- group: .../reproject_UTM
reproj = Hops(
    Points=disc.Points,
    Bool=Toggle(True),
    CacheResultsInMemory=False,
    CacheSolveResults=False,
    RemoteDefinitionLocation="http://127.0.0.1:5000/reproject_UTM",
    RemoteSolveVersion=(0, 1, 0),
    ShowInput_Enabled=False,
    ShowInput_Path=False,
    SynchronousSolve=False)

# ----
pline = PolyLine(Vertices=reverse(reproj), Closed=invert(False))
mplane = MeshPlane(Boundary=pline, WidthCount=hops.W, HeightCount=hops.H)  # -> Mesh, Area

demesh = DeconstructMesh(Mesh=mplane.Mesh)  # -> Vertices, Faces, Colours, Normals
conmesh = ConstructMesh(Vertices=demesh.Vertices, Faces=demesh.Faces, Colours=gradient)

# ---- group: .../reproject_UTM
reproj_2 = Hops(
    Points=disc_2.Points,
    Bool=Toggle(True),
    CacheResultsInMemory=True,
    CacheSolveResults=True,
    RemoteDefinitionLocation="http://127.0.0.1:5000/reproject_UTM",
    RemoteSolveVersion=(0, 1, 0),
    ShowInput_Enabled=False,
    ShowInput_Path=False,
    SynchronousSolve=False)

# ----
pline_2 = PolyLine(Vertices=reverse(reproj_2), Closed=invert(False))
mplane_2 = MeshPlane(Boundary=pline_2, WidthCount=hops_2.W, HeightCount=hops_2.H)  # -> Mesh, Area

demesh_2 = DeconstructMesh(Mesh=mplane_2.Mesh)  # -> Vertices, Faces, Colours, Normals
conmesh_2 = ConstructMesh(Vertices=demesh_2.Vertices, Faces=demesh_2.Faces, Colours=gradient_2)

# ---- group: .../reproject_UTM
reproj_3 = Hops(
    Points=disc_4.Points,
    Bool=Toggle(True),
    CacheResultsInMemory=True,
    CacheSolveResults=True,
    RemoteDefinitionLocation="http://127.0.0.1:5000/reproject_UTM",
    RemoteSolveVersion=(0, 1, 0),
    ShowInput_Enabled=False,
    ShowInput_Path=False,
    SynchronousSolve=False)

# ----
pline_3 = PolyLine(Vertices=reverse(reproj_3), Closed=invert(False))
mplane_3 = MeshPlane(Boundary=pline_3, WidthCount=hops_3.W, HeightCount=hops_3.H)  # -> Mesh, Area

demesh_3 = DeconstructMesh(Mesh=mplane_3.Mesh)  # -> Vertices, Faces, Colours, Normals
conmesh_3 = ConstructMesh(Vertices=demesh_3.Vertices, Faces=demesh_3.Faces, Colours=gradient_3)

# ---- group: .../reproject_UTM
reproj_4 = Hops(
    Points=disc_3.Points,
    Bool=Toggle(True),
    CacheResultsInMemory=True,
    CacheSolveResults=True,
    RemoteDefinitionLocation="http://127.0.0.1:5000/reproject_UTM",
    RemoteSolveVersion=(0, 1, 0),
    ShowInput_Enabled=False,
    ShowInput_Path=False,
    SynchronousSolve=False)

# ----
pline_4 = PolyLine(Vertices=reverse(reproj_4), Closed=invert(False))
mplane_4 = MeshPlane(Boundary=pline_4, WidthCount=hops_4.W, HeightCount=hops_4.H)  # -> Mesh, Area

demesh_4 = DeconstructMesh(Mesh=mplane_4.Mesh)  # -> Vertices, Faces, Colours, Normals
conmesh_4 = ConstructMesh(Vertices=demesh_4.Vertices, Faces=demesh_4.Faces, Colours=gradient_4)
